# Grasshopper definition coral.gh (Grasshopper 1.0.7)
# plug-ins: RichedGraphMapper, Opossum2_0_Proto_A, DendroGH, Parakeet

number_slider = Slider(250, range=0..1000)
number_slider_2 = Slider(0.1044, range=0.01..0.5)
number_slider_3 = Slider(45.0442, range=5..50)
number_slider_4 = Slider(0.076, range=0..0.1)
number_slider_5 = Slider(1.5902, range=0.1..5)
number_slider_6 = Slider(3.253, range=0.5..10)
number_slider_7 = Slider(0.1026, range=0..0.2)
number_slider_8 = Slider(14.274, range=0..90)
number_slider_9 = Slider(0.327, range=0..1)
number_slider_10 = Slider(9.345, range=0..45)
number_slider_11 = Slider(1.0331, range=0.9..1.1)
number_slider_12 = Slider(6, range=0..10)
number_slider_13 = Slider(0.564, range=0..1)
number_slider_14 = Slider(18, range=15..20)
dom = ConstructDomain(DomainStart=Slider(170, range=50..250), DomainEnd=number_slider)
pt = Point(Point(0, 0, 0))
galapagos = Galapagos(gene=[number_slider_8, number_slider_3, number_slider_2, number_slider_9, number_slider_13, number_slider_4, number_slider_11, number_slider_6, number_slider_7, number_slider_5, number_slider_12, number_slider_10, number_slider_14])
dom_2 = ConstructDomain(DomainStart=Slider(7, range=0..10), DomainEnd=Slider(141, range=50..150))
range = Range(Domain=dom, Steps=10)
python = GhPythonScript(
    start=pt,
    iterations=number_slider_14,
    branch_length=number_slider_3,
    branch_angle=number_slider_8,
    stem_angle=number_slider_10,
    split_probability=number_slider_2,
    seed=Slider(612, range=0..1000),
    length_jitter=number_slider_9,
    angle_jitter=number_slider_13,
    length_decay=number_slider_4,
    angle_scale=number_slider_11,
    avoid_radius=number_slider_5,
    twist_rate=number_slider_6,
    terminate_probability=number_slider_7,
    stem_generations=number_slider_12)  # -> out, segments, segments_raw, end_points, end_segments; inputs start: Point3d, iterations: Int32, seed: Int32, stem_generations: Int32
# ---------- python: Python ----------
"""
Example GhPython component script for coral growth.

This shows the recommended pattern for using the coral growth algorithm
in Grasshopper, with proper Point3d to tuple conversion.

INPUTS:
  start: Point3d - Starting point for coral growth (as a Grasshopper Point)
  iterations: int - Number of growth iterations (default: 5)
  branch_length: float - Length of each branch segment (default: 2.0)
  branch_angle: float - Maximum deviation angle in degrees (default: 25)
  split_probability: float - Probability of branching (0-1, default: 0.7)
  seed: int - Random seed for reproducibility (optional)
  stem_generations: int - Generations forced to single stem before branching (default: 0)
  stem_angle: float - Max deviation angle for the main stem in degrees (optional; default: use branch_angle)
  length_jitter: float - Random variation factor for branch length (0-1, default: 0.0)
  angle_jitter: float - Random variation factor for branch angle (0-1, default: 0.0)
  length_decay: float - Multiplicative decay factor for branch length per generation (0-1, default: 0.0)
  angle_scale: float - Scaling factor for branch angles (default: 1.0)
  avoid_radius: float - Minimum distance between branch endpoints (default: 0.0)
  twist_rate: float - Rotational twist rate in degrees per iteration (default: 0.0)
  terminate_probability: float - Probability of branch tip termination (0-1, default: 0.0)

OUTPUTS:
  out: Primary output - List of Curve objects (LineCurve) for visualization
  lines: Same as 'out' - List of Curve objects (LineCurve) for visualization
  segments: Alias of 'lines' for convenience (Curve list)
  segments_raw: List of raw segment data (tuples)
  end_segments: LineCurves that terminate the coral (no further branching)
  end_points: Points at the tips of end_segments (Point3d list)
"""

import sys
import os

# Ensure the repo's python/ folder is on sys.path so we can import coral.*
def _ensure_repo_python_on_path():
    attempted = []

    def _add(p):
        if p and os.path.isdir(p) and p not in sys.path:
            sys.path.insert(0, p)

    # 1) Explicit override via environment variable
    env_path = os.getenv('CORAL_GH_PYTHON_PATH')
    if env_path:
        attempted.append(env_path)
        _add(env_path)

    # 2) Based on the Grasshopper document location
    gh_doc = ghenv.Component.OnPingDocument()
    if gh_doc:
        gh_file = getattr(gh_doc, 'FilePath', None)
        if gh_file:
            gh_dir = os.path.dirname(gh_file)

            # Common layout: repo_root/gh/<file>.gh -> repo_root/python
            if os.path.basename(gh_dir).lower() == 'gh':
                repo_root = os.path.dirname(gh_dir)
            else:
                # If the .gh is not inside a 'gh' folder, try its parent as root
                repo_root = gh_dir

            candidates = [
                os.path.join(repo_root, 'python'),   # preferred
                os.path.join(gh_dir, 'python'),      # legacy sibling layout
            ]

            # Upward search (max 5 levels) for a python/coral folder
            cur = gh_dir
            for _ in range(5):
                candidates.append(os.path.join(cur, 'python'))
                cur = os.path.dirname(cur)

            for c in candidates:
                c = os.path.normpath(c)
                if c not in attempted:
                    attempted.append(c)
                if os.path.isdir(os.path.join(c, 'coral')):
                    _add(c)

    return attempted

_attempted_paths = _ensure_repo_python_on_path()

# Import coral growth algorithm module and force a reload so changes are picked up in GH
try:
    import coral.growth_models.simple_branching as _simple_branching
except ImportError as _e:
    msg = (
        "Could not import 'coral.growth_models.simple_branching'.\n"
        "Check that your Grasshopper file is saved inside the repo (e.g., ...\\coral-growth-gh\\gh\\yourfile.gh),\n"
        "or set the environment variable CORAL_GH_PYTHON_PATH to the absolute path of the repo's 'python' folder.\n\n"
        "Attempted locations:\n  - " + "\n  - ".join(_attempted_paths)
    )
    raise ImportError(msg)

# Reload for CPython3 (Rhino 8) or IronPython fallback
try:
    import importlib  # CPython 3.x
    _simple_branching = importlib.reload(_simple_branching)
except Exception:
    try:
        # IronPython 2.7 reload
        _simple_branching = reload(_simple_branching)  # type: ignore
    except Exception:
        pass

grow_coral = _simple_branching.grow_coral
import Rhino.Geometry as rg

# Convert Grasshopper input to a plain (x, y, z) tuple at the boundary
# Accepts Rhino.Geometry.Point3d or an (x, y, z) iterable
def _as_tuple3(value):
    try:
        # Support tuple/list-like
        x, y, z = value
        return (float(x), float(y), float(z))
    except Exception:
        pass
    # Support Rhino Point3d
    if hasattr(value, "X") and hasattr(value, "Y") and hasattr(value, "Z"):
        return (float(value.X), float(value.Y), float(value.Z))
    # Fallback default
    return (0.0, 0.0, 0.0)

start_tuple = _as_tuple3(start)

# Call the growth algorithm with plain tuple
# Robustly coerce GH inputs to valid Python types with sensible defaults
def _as_int(value, default):
    try:
        if value is None:
            return default
        return int(round(float(value)))
    except Exception:
        return default

def _as_float(value, default):
    try:
        if value is None:
            return default
        return float(value)
    except Exception:
        return default

def _as_prob(value, default):
    v = _as_float(value, default)
    # clamp to [0, 1]
    return max(0.0, min(1.0, v))

def _as_seed(value):
    if value in (None, "", False):
        return None
    try:
        return int(value)
    except Exception:
        return None

iterations_val = _as_int(globals().get('iterations', None), 5)
branch_length_val = _as_float(globals().get('branch_length', None), 2.0)
branch_angle_val = _as_float(globals().get('branch_angle', None), 25)
split_prob_val = _as_prob(globals().get('split_probability', None), 0.7)
seed_val = _as_seed(globals().get('seed', None))
stem_generations_val = max(0, _as_int(globals().get('stem_generations', None), 0))
stem_angle_val = globals().get('stem_angle', None)
try:
    stem_angle_val = None if stem_angle_val in (None, "", False) else float(stem_angle_val)
except Exception:
    stem_angle_val = None

# New parameters
length_jitter_val = _as_prob(globals().get('length_jitter', None), 0.0)
angle_jitter_val = _as_prob(globals().get('angle_jitter', None), 0.0)
length_decay_val = _as_prob(globals().get('length_decay', None), 0.0)
angle_scale_val = _as_float(globals().get('angle_scale', None), 1.0)
avoid_radius_val = _as_float(globals().get('avoid_radius', None), 0.0)
twist_rate_val = _as_float(globals().get('twist_rate', None), 0.0)
terminate_probability_val = _as_prob(globals().get('terminate_probability', None), 0.0)

_debug_lines = []

_debug_lines.append("=== Coral growth inputs ===")
_debug_lines.append("start: {}".format(start_tuple))
_debug_lines.append("iterations: {}".format(iterations_val))
_debug_lines.append("branch_length: {:.6g}".format(branch_length_val))
_debug_lines.append("branch_angle: {:.6g}".format(branch_angle_val))
_debug_lines.append("split_probability: {:.6g}".format(split_prob_val))
_debug_lines.append("seed: {}".format(seed_val if seed_val is not None else "<auto>"))
_debug_lines.append("stem_generations: {}".format(stem_generations_val))
_debug_lines.append("stem_angle: {}".format(
    "<inherit>" if stem_angle_val is None else "{:.6g}".format(stem_angle_val)
))
_debug_lines.append("length_jitter: {:.6g}".format(length_jitter_val))
_debug_lines.append("angle_jitter: {:.6g}".format(angle_jitter_val))
_debug_lines.append("length_decay: {:.6g}".format(length_decay_val))
_debug_lines.append("angle_scale: {:.6g}".format(angle_scale_val))
_debug_lines.append("avoid_radius: {:.6g}".format(avoid_radius_val))
_debug_lines.append("twist_rate: {:.6g}".format(twist_rate_val))
_debug_lines.append("terminate_probability: {:.6g}".format(terminate_probability_val))

growth_debug_lines = []

segments_raw = grow_coral(
    start=start_tuple,
    iterations=iterations_val,
    branch_length=branch_length_val,
    branch_angle=branch_angle_val,
    split_probability=split_prob_val,
    seed=seed_val,
    stem_generations=stem_generations_val,
    stem_angle=stem_angle_val,
    length_jitter=length_jitter_val,
    angle_jitter=angle_jitter_val,
    length_decay=length_decay_val,
    angle_scale=angle_scale_val,
    avoid_radius=avoid_radius_val,
    twist_rate=twist_rate_val,
    terminate_probability=terminate_probability_val,
    debug_log=growth_debug_lines,
)

# Convert output tuples back to Rhino geometry for Grasshopper display
# Use LineCurve to ensure the output is a Curve type, which plugs into Crv params.
lines = []
for seg in segments_raw:
    start_pt = rg.Point3d(*seg[0])  # Tuple -> Point3d
    end_pt = rg.Point3d(*seg[1])    # Tuple -> Point3d
    lines.append(rg.LineCurve(start_pt, end_pt))

# Identify terminal segments (their end point never reappears as another segment's start)
start_points = {seg[0] for seg in segments_raw}
end_segments_list = []
end_points_list = []
seen_end_points = set()

for seg, curve in zip(segments_raw, lines):
    endpoint = seg[1]
    if endpoint not in start_points:
        end_segments_list.append(curve)
        if endpoint not in seen_end_points:
            end_points_list.append(rg.Point3d(*endpoint))
            seen_end_points.add(endpoint)

# Backward/compat outputs:
# - 'out' is the primary output (same as 'lines' and 'segments')
# - 'segments' outputs curves as well (for users already wiring this output into a Curve param)
# - 'segments_raw' exposes the tuple data for debugging/analysis
_debug_lines.append("=== Coral growth results ===")
_debug_lines.append("segments generated: {}".format(len(segments_raw)))
_debug_lines.append("terminal segments: {}".format(len(end_segments_list)))
_debug_lines.append("terminal points: {}".format(len(end_points_list)))

if growth_debug_lines:
    _debug_lines.append("=== Growth trace ===")
    _debug_lines.extend(growth_debug_lines)

for _line in _debug_lines:
    print(_line)

out = lines
segments = lines
segments_raw = segments_raw
end_segments = end_segments_list
end_points = end_points_list
# ---------- end python ----------
panel = Panel(python.out)
pt_2 = Point(python.end_segments)
rich_graph = RichGraphMapper(
    Values=range,
    Source=number_slider,
    Target=dom_2,
    Remap=False,
    x0=0,
    x1=250,
    y0=7,
    y1=141,
    container_name="Bezier",
    cpx=[0, 0.6473097801, 0.75, 1],
    cpy=[1, 0.8724018335, 0.75, 0])
vec = VectorXYZ(XComponent=0, YComponent=0, ZComponent=range)  # -> Vector, Length
movopossum_3_0_0 = Opossum(
    OpossumData_OptimizationType=2,
    OpossumData_ResultSerializationStatus=0,
    OpossumData_objective=subtraction_6,
    OpossumData_variable=[number_slider_14, number_slider_3, number_slider_8, number_slider_2, number_slider_9, number_slider_13, number_slider_4, number_slider_11, number_slider_5, number_slider_6, number_slider_7, number_slider_12, number_slider_10])
cir = Circle(Plane=vec.Vector, Radius=rich_graph)
number_slider_15 = Slider(20, range=0..100)
number_slider_16 = Slider(1.5, range=0..5)
crv = Curve(python.segments)
explode = Explode(Curve=crv, Recursive=True)  # -> Segments, Vertices
loft = Loft(Curves=cir, Options={Adjust=False, Closed=False, LoftEnds=0, LoftSimp=0, LoftType=0, Rebuild=10, Refit=0.01})
lng = ListLength(List=crv)
bbox = BoundingBox(Content=crv, Plane=PlaneXY(0, 0, 0), UnionBox=True)  # -> Box, Box_2
divide = DivideCurve(Curve=crv, Count=Slider(2, range=2..5), Kinks=False)  # -> Points, Tangents, Parameters
shatter = Shatter(Curve=graft(crv), Parameters=divide.Parameters)  # -> flatten(Segments)
end = EndPoints(Curve=shatter)  # -> Start, End; disabled
pdecon = Deconstruct(Point=end.End)  # -> XComponent, YComponent, ZComponent
panel_2 = Panel(lng)
debox = DeconstructBox(Box=bbox.Box)  # -> Plane, X, Y, Z
avr = Average(Input=pdecon.ZComponent)
dist = Distance(PointA=end.End, PointB=pt)
dist_2 = Distance(PointA=end.Start, PointB=pt)
addition = Addition(A=number_slider_16, B=Slider(3.7, range=0..10))
dom_3 = ConstructDomain(DomainStart=number_slider_16, DomainEnd=addition)
crv_2 = Curve(python.end_segments)
bnd = Bounds(Numbers=[dist, dist_2])
dedomain = DeconstructDomain(Domain=debox.Z)  # -> Start, End
end_2 = EndPoints(Curve=crv_2)  # -> Start, End
srf_cp = SurfaceClosestPoint(Point=end_2.End, Surface=loft)  # -> Point, UVPoint, Distance
division = Division(A=srf_cp.Distance, B=Slider(15.2, range=0..100))
division_2 = Division(A=srf_cp.Distance, B=Slider(24.4, range=0..100))
min = Minimum(A=division, B="1")
min_2 = Minimum(A=division_2, B="1")
bbox_2 = BoundingBox(Content=end.End, Plane=PlaneXY(0, 0, 0), UnionBox=True)  # -> Box, Box_2
rich_graph_2 = RichGraphMapper(
    Values=dist,
    Source=bnd,
    Target=dom_3,
    Remap=False,
    x0=0,
    x1=277.7821844,
    y0=1.5,
    y1=5.2,
    container_name="Sigmoid",
    e=0.9666675329,
    t0=-100,
    t1=100)
panel_3 = Panel([debox.X, debox.Y, debox.Z])
rich_graph_3 = RichGraphMapper(
    Values=dist_2,
    Source=bnd,
    Target=dom_3,
    Remap=False,
    x0=0,
    x1=277.7821844,
    y0=1.5,
    y1=5.2,
    container_name="Sigmoid",
    e=0.9666675329,
    t0=-100,
    t1=100)
rich_graph_4 = RichGraphMapper(
    Values=min,
    Source=Domain(0, 1),
    Target=Domain(0, 1),
    Remap=False,
    x0=0,
    x1=1,
    y0=0,
    y1=1,
    container_name="Bezier",
    cpx=[0, 0, 0.3270292878, 1],
    cpy=[1, 0, 0, 0])  # -> flatten(Values)
rich_graph_5 = RichGraphMapper(
    Values=min_2,
    Source=Domain(0, 1),
    Target=Domain(0, 1),
    Remap=False,
    x0=0,
    x1=1,
    y0=0,
    y1=1,
    container_name="Bezier",
    cpx=[0, 0, 1, 1],
    cpy=[0, 0, 0, 1])  # -> flatten(Values)
debox_2 = DeconstructBox(Box=bbox_2.Box)  # -> Plane, X, Y, Z
weave = Weave(Pattern=[0, 1], Stream0=rich_graph_2, Stream1=rich_graph_3, NullGaps=False)
dedomain_2 = DeconstructDomain(Domain=debox_2.X)  # -> Start, End
dedomain_3 = DeconstructDomain(Domain=debox_2.Y)  # -> Start, End
dedomain_4 = DeconstructDomain(Domain=debox_2.Z)  # -> Start, End
addition_2 = Addition(A=dedomain_3.End, B=dedomain_4.End)
division_3 = Division(A=number_slider_16, B=3)
panel_4 = Panel("""0
1""")
ma = MassAddition(Input=rich_graph_4)  # -> Result, PartialResults
ma_2 = MassAddition(Input=rich_graph_5)  # -> Result, PartialResults
subtraction = Subtraction(A=dedomain_2.End, B=dedomain_2.Start)
subtraction_2 = Subtraction(A=dedomain_3.End, B=dedomain_3.Start)
partition = PartitionList(List=weave, Size="2")
subtraction_3 = Subtraction(A=dedomain_4.End, B=dedomain_4.Start)
multiplication = Multiplication(A=subtraction, B=subtraction_2)
subtraction_4 = Subtraction(A=ma.Result, B=ma_2.Result)
dom_4 = ConstructDomain(DomainStart=Slider(45, range=0..100), DomainEnd=addition)
vpipe = PipeVariable(Curve=crv, Radii=partition, Caps=0)  # disabled
vsettings = CreateSettings(VoxelSize=division_3, Bandwidth=1, Isovalue=0, Adaptivity=0.1)
vcurve = CurveToVolume(Curves=shatter, CurveRadius=rich_graph_2, Settings=vsettings)  # disabled
division_4 = Division(A=multiplication, B=subtraction_3)
max = Maximum(A=ma.Result, B="0.001")
panel_5 = Panel([rich_graph_4, max])
bbox_3 = BoundingBox(Content=vcurve, Plane=PlaneXY(0, 0, 0))  # -> Box, Box_2
addition_3 = Addition(A=division_4, B=dedomain_4.End)
subtraction_5 = Subtraction(A=lng, B=Slider(500, range=0..1000))
debox_3 = DeconstructBox(Box=bbox_3.Box)  # -> Plane, X, Y, Z
max_2 = Maximum(A="0.001", B=subtraction_5)
pow = Power(A=max_2, B=Slider(2, range=0..10))
multiplication_2 = Multiplication(A=pow, B=Slider(0.001, range=0.001..0.01))
subtraction_6 = Subtraction(A=subtraction_4, B=multiplication_2)
dedomain_5 = DeconstructDomain(Domain=debox_3.Z)  # -> Start, End
range_2 = Range(Domain=dedomain_5.Start, Steps=10)
vec_2 = VectorXYZ(XComponent=0, YComponent=0, ZComponent=range_2)  # -> Vector, Length
rich_graph_6 = RichGraphMapper(
    Values=range_2,
    Source=dedomain_5.Start,
    Target=dom_4,
    Remap=False,
    x0=0,
    x1=-5.114862442,
    y0=45,
    y1=5.2,
    container_name="Bezier",
    cpx=[0, 1, 1, 1],
    cpy=[1, 1, 0.2451414466, 0])
cir_2 = Circle(Plane=vec_2.Vector, Radius=rich_graph_6)
loft_2 = Loft(Curves=cir_2, Options={Adjust=False, Closed=False, LoftEnds=0, LoftSimp=0, LoftType=0, Rebuild=10, Refit=0.01})
mvolume = VolumeToMesh(Volume=vcurve, VolumeSettings=vsettings)
cap = CapHoles(Brep=loft_2)
createsolid = CreateSolid(Breps=cap)
mesh = MeshBrep(
    Brep=createsolid,
    Settings={GridMaxCount=0, GridMinCount=16, JaggedSeams=False, MaxEdgeLength=0, MinEdgeLength=0.0001, MinTolerance=0, Refine=True, RefineAngle=0, RelativeTolerance=0.65, SimplePlanes=True, Tolerance=0})
munion = MeshUnion(Meshes=flatten([mesh, mvolume]))  # disabled
vmesh = MeshToVolume(Mesh=mesh, Settings=vsettings)
vunion = VolumeUnion(Volumes=[vmesh, vcurve])
